# Grasshopper definition animal issue fix.gh (Grasshopper 1.0.7)
# plug-ins: Pufferfish

unit_x = UnitX(Factor=Slider(1.1, range=0..10))
geometry = Geometry(<mesh referenced from the Rhino model>)
area = Area(Geometry=geometry)  # -> Area, Centroid
yz_plane = YZPlane(Origin=Point(0, 0, 0))
number_slider = Slider(0.6, range=0..1)
number_slider_2 = Slider(8, range=0..100)
scale = Scale(Geometry=geometry, Center=Point(0, 0, 0), Factor=unit_x)  # -> Geometry, Transform
number_slider_3 = Slider(1.2, range=0..10)
rotate = Rotate(Geometry=scale.Geometry, Angle=degrees(Slider(90, range=0..100)), Plane=yz_plane)  # -> Geometry, Transform
area_2 = Area(Geometry=rotate.Geometry)  # -> Area, Centroid
unit_x_2 = UnitX(Factor=number_slider)
unit_y = UnitY(Factor=number_slider)
scale_2 = Scale(Geometry=scale.Geometry, Center=Point(0, 0, 0), Factor=number_slider)  # -> Geometry, Transform
unit_z = UnitZ(Factor=Slider(9, range=0..100))
geometry_2 = Geometry(<mesh referenced from the Rhino model>)
unit_z_2 = UnitZ(Factor=expr("-x", Slider(14, range=0..100)))
area_3 = Area(Geometry=scale_2.Geometry)  # -> Area, Centroid
area_4 = Area(Geometry=scale_2.Geometry)  # -> Area, Centroid
area_5 = Area(Geometry=geometry_2)  # -> Area, Centroid
number_slider_4 = Slider(74, range=0..100)
area_6 = Area(Geometry=geometry_2)  # -> Area, Centroid
move = Move(Geometry=area_4.Centroid, Motion=unit_z_2)  # -> Geometry, Transform
move_to_point = MoveToPoint(Geometry=scale_2.Geometry, PointA=move.Geometry, PointB=area_5.Centroid)  # -> Moved, Vector, Transform
unit_y_2 = UnitY(Factor=expr("-x", number_slider_4))
unit_y_3 = UnitY(Factor=number_slider_4)
move_2 = Move(Geometry=move_to_point.Moved, Motion=unit_y_3)  # -> Geometry, Transform
mesh_join = MeshJoin(Meshes=flatten([move_2.Geometry, geometry_2]))
