# Grasshopper definition model1+2.gh (Grasshopper 1.0.7)
# plug-ins: Pufferfish

number_slider = Slider(0.9, range=0..1)
number_slider_2 = Slider(31, range=0..100)
multiplication = Multiplication(A=number_slider, B=number_slider_2)
rectangle = Rectangle(Plane=PlaneXY(0, 0, 0), XSize=Slider(75, range=0..100), YSize=Slider(13, range=0..100), Radius=0)  # -> Rectangle, Length
number_slider_3 = Slider(0.95, range=0..1)
circle = Circle(Plane=PlaneXY(0, 0, 0), Radius=number_slider_2)
multiplication_2 = Multiplication(A=multiplication, B=number_slider)
area = Area(Geometry=circle)  # -> Area, Centroid
panel = Panel(multiplication_2)
surface = Surface(circle)
scale = Scale(Geometry=circle, Center=area.Centroid, Factor=number_slider_3)  # -> Geometry, Transform
surface_2 = Surface(scale.Geometry)
unit_z = UnitZ(Factor=Slider(16, range=0..100))
unit_z_2 = UnitZ(Factor=Slider(20, range=0..100))
extrude = Extrude(Base=surface_2, Direction=unit_z)
extrude_2 = Extrude(Base=surface, Direction=unit_z_2)
unit_y = UnitY(Factor=Slider(68, range=0..100))
solid_difference = SolidDifference(BrepsA=extrude_2, BrepsB=extrude)
move = Move(Geometry=surface_2, Motion=unit_y)  # -> Geometry, Transform
deconstruct_brep = DeconstructBrep(Brep=extrude_2)  # -> Faces, Edges, Vertices
dispatch = Dispatch(List=solid_difference, DispatchPattern=[True, False])  # -> ListA, ListB
unit_z_3 = UnitZ(Factor=Slider(25, range=0..100))
list_item = ListItem(List=deconstruct_brep.Faces, Index=0, Wrap=True)  # -> Item1, Item
extrude_3 = Extrude(Base=move.Geometry, Direction=unit_z_3)
geometry = Geometry(dispatch.ListA)
geometry_2 = Geometry(list_item.Item1)
area_2 = Area(Geometry=geometry_2)  # -> Area, Centroid
deconstruct_brep_2 = DeconstructBrep(Brep=extrude_3)  # -> Faces, Edges, Vertices
geometry_3 = Geometry(<mesh referenced from the Rhino model>)
yz_plane = YZPlane(Origin=Point(0, 0, 0))
list_item_2 = ListItem(List=deconstruct_brep_2.Faces, Index=0, Wrap=True)  # -> Item1, Item
geometry_4 = Geometry(list_item_2.Item1)
unit_z_4 = UnitZ(Factor=Slider(21, range=0..100))
rotate = Rotate(Geometry=geometry_3, Angle=expr("-X", degrees(Slider(23, range=0..100))), Plane=yz_plane)  # -> Geometry, Transform
area_3 = Area(Geometry=geometry_4)  # -> Area, Centroid
scale_2 = Scale(Geometry=geometry_4, Center=area_3.Centroid, Factor=number_slider_3)  # -> Geometry, Transform
area_4 = Area(Geometry=rotate.Geometry)  # -> Area, Centroid
extrude_4 = Extrude(Base=scale_2.Geometry, Direction=expr("-x", unit_z_4))
unit_z_5 = UnitZ(Factor=expr("-X", Slider(8, range=0..100)))
solid_difference_2 = SolidDifference(BrepsA=extrude_3, BrepsB=extrude_4)
number_slider_4 = Slider(69, range=0..100)
number_slider_5 = Slider(5, range=0..10)
number_slider_6 = Slider(5, range=0..10)
mesh_brep = MeshBrep(
    Brep=geometry,
    Settings={GridMaxCount=0, GridMinCount=16, JaggedSeams=False, MaxEdgeLength=0, MinEdgeLength=0.0001, MinTolerance=0, Refine=True, RefineAngle=0, RelativeTolerance=0.65, SimplePlanes=True, Tolerance=0})
move_2 = Move(Geometry=area_4.Centroid, Motion=unit_z_5)  # -> Geometry, Transform
dispatch_2 = Dispatch(List=solid_difference_2, DispatchPattern=[True, False])  # -> ListA, ListB
unit_y_2 = UnitY(Factor=Slider(10, range=0..100))
unit_y_3 = UnitY(Factor=number_slider_4)
geometry_5 = Geometry(dispatch_2.ListA)
unit_x = UnitX(Factor=number_slider_4)
linear_array = LinearArray(Geometry=geometry_5, Direction=unit_y_3, Count=number_slider_5)  # -> Geometry, Transform
move_3 = Move(Geometry=move_2.Geometry, Motion=unit_y_2)  # -> Geometry, Transform
move_to_point = MoveToPoint(Geometry=rotate.Geometry, PointA=move_3.Geometry, PointB=area_2.Centroid)  # -> Moved, Vector, Transform
merge = Merge(Data1=flatten(mesh_brep), Data2=flatten(move_to_point.Moved))
unit_x_2 = UnitX(Factor=number_slider_4)
linear_array_2 = LinearArray(Geometry=geometry, Direction=unit_y_3, Count=number_slider_5)  # -> Geometry, Transform

linear_array_3 = LinearArray(Geometry=linear_array_2.Geometry, Direction=unit_x_2, Count=number_slider_6)  # -> flatten(Geometry), Transform
linear_array_4 = LinearArray(Geometry=linear_array.Geometry, Direction=unit_x, Count=number_slider_6)  # -> Geometry, Transform
mesh_union = MeshUnion(Meshes=merge)

geometry_6 = Geometry(<mesh referenced from the Rhino model>)

number_slider_7 = Slider(90, range=0..100)
geometry_7 = Geometry([<mesh referenced from the Rhino model> x402])
yz_plane_2 = YZPlane(Origin=Point(0, 0, 0))
number_slider_8 = Slider(0.9, range=0..1)
number_slider_9 = Slider(0.0572, range=0..0.1)
number_slider_10 = Slider(0.9, range=0..1)
rotate_2 = Rotate(Geometry=geometry_6, Angle=expr("X", degrees(number_slider_7)), Plane=yz_plane_2)  # -> Geometry, Transform
cull_index = CullIndex(List=linear_array_3.Geometry, Indices=Slider(0, range=0..100), Wrap=True)
rotate_3 = Rotate(Geometry=geometry_7, Angle=expr("X", degrees(number_slider_7)), Plane=yz_plane_2)  # -> Geometry, Transform
number_slider_11 = Slider(10, range=0..10)
list_item_3 = ListItem(List=cull_index, Index=Slider(23, range=0..100), Wrap=True)
scale_3 = Scale(Geometry=rotate_2.Geometry, Center=Point(0, 0, 0), Factor=Slider(2.294, range=0..100))  # -> Geometry, Transform
deconstruct_brep_3 = DeconstructBrep(Brep=list_item_3)  # -> Faces, Edges, Vertices
number_slider_12 = Slider(0, range=0..10000)
unit_z_6 = UnitZ(Factor=expr("-X", Slider(7.3, range=0..100)))
number_slider_13 = Slider(10, range=0..10)
unit_z_7 = UnitZ(Factor=Slider(0, range=0..10000))
mesh_join = MeshJoin(Meshes=scale_3.Geometry)
list_item_4 = ListItem(List=deconstruct_brep_3.Faces, Index=0, Wrap=True)  # -> Item3, Item2, Item1, Item
unit_x_3 = UnitX(Factor=expr("-x", number_slider_12))
area_5 = Area(Geometry=mesh_join)  # -> Area, Centroid
unit_x_4 = UnitX(Factor=number_slider_12)
geometry_8 = Geometry(list_item_4.Item3)
move_4 = Move(Geometry=area_5.Centroid, Motion=unit_z_6)  # -> Geometry, Transform
unit_y_4 = UnitY(Factor=Slider(32, range=0..100))
area_6 = Area(Geometry=geometry_8)  # -> Area, Centroid
move_5 = Move(Geometry=move_4.Geometry, Motion=unit_x_3)  # -> Geometry, Transform
group = Group(Objects=scale_3.Geometry)
move_to_point_2 = MoveToPoint(Geometry=group, PointA=move_5.Geometry, PointB=area_6.Centroid)  # -> Moved, Vector, Transform
mesh_brep_2 = MeshBrep(
    Brep=list_item_3,
    Settings={GridMaxCount=0, GridMinCount=16, JaggedSeams=False, MaxEdgeLength=0, MinEdgeLength=0.0001, MinTolerance=0, Refine=True, RefineAngle=0, RelativeTolerance=0.65, SimplePlanes=True, Tolerance=0})
ungroup = Ungroup(Group=move_to_point_2.Moved)  # -> flatten(Objects)
mesh = Mesh([<mesh referenced from the Rhino model> x19])
unit_y_5 = UnitY(Factor=Slider(142, range=0..1000))
mesh_join_2 = MeshJoin(Meshes=[mesh_brep_2, ungroup])
linear_array_5 = LinearArray(Geometry=mesh, Direction=unit_y_5, Count=Slider(2, range=0..10))  # -> Geometry, Transform
