# Grasshopper definition test test_1.gh (Grasshopper 1.0.8)

panel = Panel("""10 to 11
12 to 14
15 to 16
17 to 19
20 to 21
22 to 24""")
geometry = Geometry([<mesh referenced from the Rhino model> x38])
rectangle = Rectangle(Plane=PlaneXY(0, 0, 0), XSize=Slider(210, range=0..1000), YSize=Slider(190, range=0..1000), Radius=0)  # -> Rectangle, Length
list_item = ListItem(List=geometry, Index=0, Wrap=True)
panel_2 = Panel("""3
4 to 4
4 to 5
6 to 8""")
dispatch = Dispatch(List=geometry, DispatchPattern=[True, False])  # -> ListA, ListB
unit_z = UnitZ(Factor=Slider(200, range=0..1000))
extrude = Extrude(Base=rectangle.Rectangle, Direction=unit_z)
unit_x = UnitX(Factor=expr("-x", Slider(7, range=0..10)))
geometry_2 = Geometry([<mesh referenced from the Rhino model> x9])
panel_3 = Panel("""3
4 to 9
10 to 11
14 to 16
17 to 18
8 to 9 """)
number_slider = Slider(3, range=0..10)
dispatch_2 = Dispatch(List=dispatch.ListA, DispatchPattern=[True, False])  # -> ListA, ListB
number_slider_2 = Slider(3, range=0..10)
geometry_3 = Geometry(dispatch.ListB)
move = Move(Geometry=extrude, Motion=unit_x)  # -> Geometry, Transform
unit_y = UnitY(Factor=expr("-x", Slider(20, range=0..100)))
sub_list = SubList(List=geometry_2, Domain=panel_2, Wrap=True)  # -> List, Index
geometry_4 = Geometry([<brep referenced from the Rhino model> x25])
sub_list_2 = SubList(List=geometry_4, Domain=panel, Wrap=True)  # -> List, Index
explode_tree = ExplodeTree(Data=sub_list_2.List)  # -> Branch0, Branch1, Branch2, Branch3, Branch4, Branch5, Branch6, Branch7
geometry_5 = Geometry(explode_tree.Branch0)
geometry_6 = Geometry(explode_tree.Branch3)
geometry_7 = Geometry(explode_tree.Branch2)
geometry_8 = Geometry(explode_tree.Branch5)
geometry_9 = Geometry(explode_tree.Branch4)
split_list = SplitList(List=dispatch_2.ListA, Index=number_slider)  # -> ListA, ListB
explode_tree_2 = ExplodeTree(Data=sub_list.List)  # -> Branch0, Branch1, Branch2, Branch3, Branch4, Branch5, Branch6, Branch7
split_list_2 = SplitList(List=geometry_4, Index=number_slider)  # -> ListA, ListB
move_2 = Move(Geometry=move.Geometry, Motion=unit_y)  # -> Geometry, Transform
sub_list_3 = SubList(List=geometry_3, Domain=panel_3, Wrap=True)  # -> List, Index
unit_x_2 = UnitX(Factor=Slider(144, range=0..1000))
sub_list_4 = SubList(List=dispatch.ListA, Domain=panel_3, Wrap=True)  # -> List, Index
geometry_10 = Geometry(explode_tree_2.Branch1)
geometry_11 = Geometry(split_list.ListA)
geometry_12 = Geometry(split_list_2.ListA)
geometry_13 = Geometry(explode_tree_2.Branch3)
explode_tree_3 = ExplodeTree(Data=sub_list_3.List)  # -> Branch0, Branch1, Branch2, Branch3, Branch4, Branch5
geometry_14 = Geometry(explode_tree_3.Branch5)
geometry_15 = Geometry(explode_tree_2.Branch0)
geometry_16 = Geometry(explode_tree_2.Branch2)
move_3 = Move(Geometry=geometry_14, Motion=unit_x_2)  # -> Geometry, Transform
unit_x_3 = UnitX(Factor=expr("-x", Slider(138.082, range=0..1000)))
explode_tree_4 = ExplodeTree(Data=sub_list_4.List)  # -> Branch0, Branch1, Branch2, Branch3, Branch4, Branch5
unit_y_2 = UnitY(Factor=expr("-x", Slider(66, range=0..100)))
unit_y_3 = UnitY(Factor=expr("-x", Slider(75, range=0..100)))
geometry_17 = Geometry(geometry_10)
geometry_18 = Geometry(explode_tree_3.Branch0)
geometry_19 = Geometry(explode_tree_3.Branch1)
geometry_20 = Geometry(explode_tree_3.Branch2)
geometry_21 = Geometry(explode_tree_3.Branch3)
geometry_22 = Geometry(explode_tree_3.Branch4)
move_4 = Move(Geometry=[geometry_16, geometry_15], Motion=unit_y_2)  # -> Geometry, Transform
geometry_23 = Geometry(explode_tree_4.Branch0)
geometry_24 = Geometry(explode_tree_4.Branch1)
geometry_25 = Geometry(explode_tree_4.Branch2)
geometry_26 = Geometry(explode_tree_4.Branch3)
geometry_27 = Geometry(explode_tree_4.Branch4)
move_5 = Move(Geometry=move_3.Geometry, Motion=unit_y_3)  # -> Geometry, Transform
move_6 = Move(Geometry=move_4.Geometry, Motion=unit_x_3)  # -> Geometry, Transform
mesh_join = MeshJoin(Meshes=flatten([geometry_17, move_6.Geometry, geometry_13]))
mesh_join_2 = MeshJoin(Meshes=flatten([geometry_8, geometry_6]))
mesh_join_3 = MeshJoin(Meshes=flatten([geometry_25, geometry_27, geometry_18, geometry_20, geometry_22]))
mesh_join_4 = MeshJoin(Meshes=flatten([geometry_19, geometry_21, move_5.Geometry]))
mesh_join_5 = MeshJoin(Meshes=flatten([geometry_9, geometry_5, geometry_7]))
mesh_join_6 = MeshJoin(Meshes=flatten([geometry_12, geometry_11]))
