# Grasshopper definition tree issue fix.gh (Grasshopper 1.0.8)
# plug-ins: Pufferfish

unit_x = UnitX(Factor=Slider(1.1, range=0..10))
geometry = Geometry(<mesh referenced from the Rhino model>)
area = Area(Geometry=geometry)  # -> Area, Centroid
yz_plane = YZPlane(Origin=Point(0, 0, 0))
scale = Scale(Geometry=geometry, Center=area.Centroid, Factor=unit_x)  # -> Geometry, Transform
rotate = Rotate(Geometry=scale.Geometry, Angle=degrees(Slider(90, range=0..100)), Plane=yz_plane)  # -> Geometry, Transform
area_2 = Area(Geometry=rotate.Geometry)  # -> Area, Centroid
scale_2 = Scale(Geometry=rotate.Geometry, Center=area_2.Centroid, Factor=Slider(27, range=0..100))  # -> Geometry, Transform
unit_z = UnitZ(Factor=Slider(9, range=0..100))
geometry_2 = Geometry(<mesh referenced from the Rhino model>)
unit_z_2 = UnitZ(Factor=expr("-x", Slider(38, range=0..100)))
area_3 = Area(Geometry=scale_2.Geometry)  # -> Area, Centroid
area_4 = Area(Geometry=geometry_2)  # -> Area, Centroid
move = Move(Geometry=area_3.Centroid, Motion=unit_z_2)  # -> Geometry, Transform
move_to_point = MoveToPoint(Geometry=scale_2.Geometry, PointA=move.Geometry, PointB=area_4.Centroid)  # -> Moved, Vector, Transform
move_2 = Move(Geometry=move_to_point.Moved, Motion=unit_z)  # -> Geometry, Transform
mesh_join = MeshJoin(Meshes=flatten([move_2.Geometry, geometry_2]))
